# Dynamo graph BASE LAYER_script.dyn "LAYER" (Dynamo 2.18.1.5096)
# packages: bimorphNodes 5.1.3

select_model_element = DSModelElementSelection()  # nothing selected; graph input
watch = Watch(select_model_element)

# group: LAYER ALVENARIA
layerNames = Revit.ImportInstance.LayerNames(importInstance=watch)
LAYER = CodeBlock { ("ALVENARIA"); }
contains = String.Contains(string=layerNames, searchFor=LAYER)
filterByBoolMask = List.FilterByBoolMask(list=layerNames, mask=contains)
watch_2 = Watch(filterByBoolMask.in)
espessura_da_linha = CodeBlock { (3); }
color_palette = ColorPalette({R: 0, G: 0, B: 0, A: 255})
setObjectStyle = Revit.ImportInstance.SetObjectStyle(importInstance=watch, layerName=watch_2, projectionWeight=[espessura_da_linha, espessura_da_linha], color=color_palette)
watch_3 = Watch(filterByBoolMask.out)

# group: LAYER PILAR
watch_4 = Watch(watch_3)
LAYER_2 = CodeBlock { ("I2N_PILAR"); }
contains_2 = String.Contains(string=watch_4, searchFor=LAYER_2)
filterByBoolMask_2 = List.FilterByBoolMask(list=watch_4, mask=contains_2)
watch_5 = Watch(filterByBoolMask_2.in)
espessura_da_linha_2 = CodeBlock { (4); }
color_palette_2 = ColorPalette({R: 0, G: 0, B: 0, A: 255})
setObjectStyle_2 = Revit.ImportInstance.SetObjectStyle(importInstance=watch, layerName=watch_5, projectionWeight=[espessura_da_linha_2, espessura_da_linha_2], color=color_palette_2)
watch_6 = Watch(filterByBoolMask_2.out)

# group: LAYER DRYWALL
watch_7 = Watch(watch_6)
LAYER_3 = CodeBlock { ("I2N_DRYWALL"); }
contains_3 = String.Contains(string=watch_7, searchFor=LAYER_3)
filterByBoolMask_3 = List.FilterByBoolMask(list=watch_7, mask=contains_3)
watch_8 = Watch(filterByBoolMask_3.in)
espessura_da_linha_3 = CodeBlock { (3); }
color_palette_3 = ColorPalette({R: 128, G: 128, B: 128, A: 255})
setObjectStyle_3 = Revit.ImportInstance.SetObjectStyle(importInstance=watch, layerName=watch_8, projectionWeight=[espessura_da_linha_3, espessura_da_linha_3], color=color_palette_3)
watch_9 = Watch(filterByBoolMask_3.out)

# group: LAYER VIDRO
watch_10 = Watch(watch_9)
LAYER_4 = CodeBlock { ("I2N_VIDRO"); }
contains_4 = String.Contains(string=watch_10, searchFor=LAYER_4)
filterByBoolMask_4 = List.FilterByBoolMask(list=watch_10, mask=contains_4)
watch_11 = Watch(filterByBoolMask_4.in)
espessura_da_linha_4 = CodeBlock { (2); }
color_palette_4 = ColorPalette({R: 127, G: 191, B: 255, A: 255})
setObjectStyle_4 = Revit.ImportInstance.SetObjectStyle(importInstance=watch, layerName=watch_11, projectionWeight=[espessura_da_linha_4, espessura_da_linha_4], color=color_palette_4)
watch_12 = Watch(filterByBoolMask_4.out)

# group: LAYER LUMINÁRIA
watch_13 = Watch(watch_12)
LAYER_5 = CodeBlock { ("I2N_LUMINÁRIA"); }
contains_5 = String.Contains(string=watch_13, searchFor=LAYER_5)
filterByBoolMask_5 = List.FilterByBoolMask(list=watch_12, mask=contains_5)
watch_14 = Watch(filterByBoolMask_5.out)
watch_15 = Watch(filterByBoolMask_5.in)
espessura_da_linha_5 = CodeBlock { (3); }
color_palette_5 = ColorPalette({R: 255, G: 127, B: 1, A: 255})
setObjectStyle_5 = Revit.ImportInstance.SetObjectStyle(importInstance=watch, layerName=watch_15, projectionWeight=[espessura_da_linha_5, espessura_da_linha_5], color=color_palette_5)

# group: LAYER NA COR 8
espessura_da_linha_6 = CodeBlock { (1); }
color_palette_6 = ColorPalette({R: 128, G: 128, B: 128, A: 255})
setObjectStyle_6 = Revit.ImportInstance.SetObjectStyle(importInstance=watch, layerName=watch_14, projectionWeight=[espessura_da_linha_6, espessura_da_linha_6], color=color_palette_6)
